# Grasshopper definition Pi_ICP_Demo_Ver+Op45.gh (Grasshopper 1.0.8)
# plug-ins: RhinoCodePluginGH, Volvox, Dodo, CockroachGH

# ---- group: Input
mesh = Mesh([<mesh referenced from the Rhino model> x889])
brep = Brep(<brep referenced from the Rhino model>)
pcloud = PointCloud(<point cloud referenced from the Rhino model>)
clo = Cloud(<cloud referenced from the Rhino model>)
# Finite element Iterative Closest Point Registration
mesh_2 = Mesh(<mesh referenced from the Rhino model>)

# ----
mjoin = MeshJoin(Meshes=mesh)
F = File("C:\Users\giuli\OneDrive - unige.it\Dottorato\Papers\013_FE_ICP_LondonBridge_Sinan\First Submission\DemoICP\45_UVEC_1.39.txt")
panel = Panel(F)

# ---- group: Crack Curves
# Crack curves is used to assign a scalar field to the vertex of the reference geometry, based on the point-curve distance from the Crack Curve according to the Crack Influence parameter.
# The scalar field is computed on the registed template after a first iteration of the FE_ICP, then a second iteration of the FE_ICP is perfomer using the Crack Scalar Field as a multiplier for the stifness parameter alpha.
list = ValueList({"No Cracks": 0, "Cracks": 1}, selected="Cracks")
crv = Curve([<curve referenced from the Rhino model> x3])
entwine = Entwine(Branch01=crv, FlattenInputs=True)  # -> simplify(Result)
branch = TreeBranch(Tree=entwine, Path=list, MaintainPaths=False)

# ----
file = ReadFile(File=F, PerLineParse=True)
tri = Triangulate(Mesh=mesh_2)  # -> Mesh, Count
pt = Point(<point referenced from the Rhino model>)
mesh_3 = Mesh(mjoin)

# ----
# Mesh to register.
# Should be a regular triangular mesh, following the same criteria of meshes used for FEM models.
meshrepair = MeshRepair(Mesh=tri.Mesh)

mcompare = MeshCompare(Cloud=clo, Mesh=meshrepair, Key="dist")
cullc = CullCloud(Cloud=mcompare, Key="dist", Domain=" -0.25 to 0.1")
decloud = DeconstructCloud(Cloud=cullc)  # -> Points, Normals, Colors
point_cloud = PointCloudAttributes(Locations=decloud.Points)  # -> Cloud, Locations, Normals, Colours, Extra, Hidden

# ---- group: Input_2_Target
# Nurbs, meshes and point clouds can be used as referenge geometry.
# 
# Only native grasshopper point clouds can be used as a reference.
# Point clouds are not fully supported in grashopper so both nodes (rh and volvox) must be referenced, in the first case to input it directly, in the second case if preprocessing is needed
list_2 = ValueList({"Nurbs": 0, "Mesh": 1, "PointCloud": 2, "PointCloud + VolvoxPreprocessing": 3}, selected="Mesh")
entwine_2 = Entwine(Branch00=brep, Branch01=mjoin, Branch02=pcloud, Branch03=point_cloud.Cloud, FlattenInputs=True)  # -> simplify(Result)
branch_2 = TreeBranch(Tree=entwine_2, Path=list_2, MaintainPaths=False)

# ----
getdata = GetData(Cloud=cullc, Key="dist")

# ---- group: Undef
medges = MeshEdges(Mesh=meshrepair)  # -> NakedEdges, InteriorEdges, NonManifoldEdges
demesh = DeconstructMesh(Mesh=meshrepair)  # -> Vertices, Faces, Colours, Normals

# ----
lng = ListLength(List=demesh.Vertices)
random = Random(Range=Domain(0, 1), Number=lng, Seed=2)
dist = Distance(PointA=pt, PointB=demesh.Vertices)
larger = LargerThan(FirstNumber=dist, SecondNumber=Slider(0.082, range=0..1))  # -> LargerThan, OrEqualTo
larger_2 = LargerThan(FirstNumber=random, SecondNumber=Slider(0.159, range=0..1))  # -> LargerThan, OrEqualTo

# ---- group: W_k
cloud = ConstructCloud(Points=demesh.Vertices)
medges_2 = MeshEdges(Mesh=mesh_3)  # -> NakedEdges, InteriorEdges, NonManifoldEdges
mcompare_2 = MeshCompare(Cloud=cloud, Mesh=mesh_3, Key="dist")
getdata_2 = GetData(Cloud=mcompare_2, Key="dist")
abs = Absolute(Value=getdata_2)
bnd = Bounds(Numbers=abs)
smaller = SmallerThan(FirstNumber=abs, SecondNumber=Slider(0.06, range=0..1))  # -> SmallerThan, OrEqualTo
panel_2 = Panel(bnd)
num = Number(smaller.SmallerThan)
graph = GraphMapper(
    num,
    x0=0,
    x1=1,
    y0=0,
    y1=1,
    A=0.75,
    B=0.25,
    container_name="Linear",
    Graph_x0=0.14,
    Graph_x1=0.7,
    Graph_y0=0.355,
    Graph_y1=0.775)
gradient = Gradient(LowerLimit=0, UpperLimit=1, Parameter=graph, stops=[0: RGB(0, 128, 0), 0.5: RGB(255, 255, 0), 1: RGB(255, 0, 0)])
bar_graph = BarGraph(graph, BarColor=RGB(255, 0, 90))
cloud_2 = ConstructCloud(Points=demesh.Vertices, Colors=gradient)

# ----
num_2 = Number(larger.LargerThan)
gradient_2 = Gradient(LowerLimit=0, UpperLimit=1, Parameter=num_2, stops=[0: RGB(0, 128, 0), 0.5: RGB(255, 255, 0), 1: RGB(255, 0, 0)])
bar_graph_2 = BarGraph(num_2, BarColor=RGB(255, 0, 90))
bnd_2 = Bounds(Numbers=getdata)
split = TextSplit(Text=file, Separators="\t")  # -> simplify(Result)
abs_2 = Absolute(Value=bnd_2)
dedomain = DeconstructDomain(Domain=" -0.25 to 0.1")  # -> Start, End
rep = ReplaceText(Text=split, Find=",", Replace=".", RecursiveReplace=False)
cloud_3 = ConstructCloud(Points=demesh.Vertices, Colors=gradient_2)
max = Maximum(A=dedomain.Start, B=dedomain.End)
gradient_3 = Gradient(
    LowerLimit=expr("x*-1", max),
    UpperLimit=max,
    Parameter=getdata,
    stops=[0: RGB(0, 0, 255), 0.25: RGB(192, 255, 255), 0.5: RGB(0, 128, 0), 0.75: RGB(255, 255, 0), 1: RGB(255, 0, 0)])
prevdata = PreviewData(Cloud=cullc, Key="dist", Values=getdata, Colors=gradient_3)
item = ListItem(List=rep, Index="0", Wrap=True)  # -> flatten(Item)
item_2 = ListItem(List=rep, Index="1", Wrap=True)  # -> flatten(Item)
item_3 = ListItem(List=rep, Index="2", Wrap=True)  # -> flatten(Item)
item_4 = ListItem(List=rep, Index="3", Wrap=True)  # -> flatten(Item)
item_5 = ListItem(List=rep, Index="4", Wrap=True)  # -> flatten(Item)
item_6 = ListItem(List=rep, Index="5", Wrap=True)  # -> flatten(Item)
item_7 = ListItem(List=rep, Index="6", Wrap=True)  # -> flatten(Item)
cull_i = CullIndex(List=item, Indices="0", Wrap=True)
cull_i_2 = CullIndex(List=item_2, Indices="0", Wrap=True)
cull_i_3 = CullIndex(List=item_3, Indices="0", Wrap=True)
cull_i_4 = CullIndex(List=item_4, Indices="0", Wrap=True)
cull_i_5 = CullIndex(List=item_5, Indices="0", Wrap=True)
cull_i_6 = CullIndex(List=item_6, Indices="0", Wrap=True)
cull_i_7 = CullIndex(List=item_7, Indices="0", Wrap=True)
pt_2 = ConstructPoint(XCoordinate=cull_i_2, YCoordinate=cull_i_3, ZCoordinate=cull_i_4)
vec = VectorXYZ(XComponent=cull_i_5, YComponent=cull_i_6, ZComponent=cull_i_7)  # -> Vector, Length
move = Move(Geometry=pt_2, Motion=vec.Vector)  # -> Geometry, Transform
point_cloud_2 = PointCloudAttributes(Locations=move.Geometry)  # -> Cloud, Locations, Normals, Colours, Extra, Hidden

# ---- group: Average Element Size (m)
# This can guide you to pick a reasonable crack influence
area = Area(Geometry=meshrepair)  # -> Area, Centroid
lng_2 = ListLength(List=demesh.Faces)
division = Division(A=area.Area, B=lng_2)
sqrt = SquareRoot(Value=division)
panel_3 = Panel(sqrt)

# ----
epsilonthreshold = Slider(0.05, range=0..1)
epsilon_maxstep = Slider(15, range=1..50)
cracks_influence = Slider(0.1, range=0..1)
alpha_step = Slider(25, range=1..50)
alpha_max = Slider(50, range=0..100)
alpha_min = Slider(0.01, range=0.01..10)
panel_4 = Panel("Original U_FEM")
panel_5 = Panel("U_ICP - DIRECTIONAL Displacements")

# ---- group: Input
# Local Reference system rotation
number_slider = Slider(0, range=-180..180)
list_3 = ValueList({"Global X": 0, "Global Y": 1, "Global Z": 2, "Local X": 3, "Local Y": 4, "Local Z": 5}, selected="Global Z")
number_slider_2 = Slider(0.05, range=0..100)
number_slider_3 = Slider(0.36, range=0.001..1)
number_slider_4 = Slider(0.75, range=0.15..2)
panel_6 = Panel("Value")
panel_7 = Panel("Scale")
list_4 = ValueList({"Value": 0, "Scale": 1}, selected="Scale")
number_slider_5 = Slider(0.11, range=0..1)

# ----
# COMPARISON AMONG DISPLACEMENT FIELDS
panel_8 = Panel("Remapped U_Fem")
panel_9 = Panel("Vertex")
panel_10 = Panel("Elements")
panel_11 = Panel("U_ICP")
panel_14 = Panel("U_Vector")
panel_17 = Panel("0")
number_slider_6 = Slider(0.66, range=-50..50)
panel_18 = Panel("Bake to see")

# ---- group: Your code to define the imposed displacements
# This si the code I used to retrieve the displacements of a barrel bault springs given the edges of the mesh and the corresponding curves representing the spring from the point cloud.
# 
# This can be done in many ways.
crv_2 = Curve(<curve referenced from the Rhino model>)
crv_3 = Curve(<curve referenced from the Rhino model>)
crv_4 = Curve(<curve referenced from the Rhino model>)
crv_5 = Curve(<curve referenced from the Rhino model>)
entwine_3 = Entwine(Branch00=crv_2, Branch01=crv_3, FlattenInputs=True)  # -> simplify(Result)
entwine_4 = Entwine(Branch00=crv_4, Branch01=crv_5, FlattenInputs=True)  # -> simplify(Result)
cp = ControlPoints(Curve=entwine_3)  # -> Points, Weights, Knots
pt_3 = Point()
vec_2 = Vector()

# ----
trim = TrimTree(Tree=cp.Points, Depth=1)

# ---- group: Your code to define the imposed displacements (continued)
crv_cp = CurveClosestPoint(Point=trim, Curve=entwine_4)  # -> Point, Parameter, Distance
vec2pt = Vector2Pt(PointA=trim, PointB=crv_cp.Point, Unitize=False)  # -> Vector, Length

# ---- group: W_k
# W_k is the scalar field on the template vertexes used to weight the distance term according to reliability of the possibile matches between points in the template and in the reference geometry.
# For values under 0.25, the corresponding distance temr is omitted and the normal regularization termi is introduced instead.
list_5 = ValueList({"No W_k": 0, "Treshhold W_k": 1, "Personalized W_k": 2}, selected="No W_k")

# ---- group: Landmark
# Landmark Point on the Template
# Check here the preview of the displacement field
merge = Merge(Data1=flatten(trim), Data2=flatten(pt_3))
merge_2 = Merge(Data1=flatten(vec2pt.Vector), Data2=flatten(vec_2))
panel_19 = Panel("Imposed Displacement Vectors")

# ---- group: Landmark / Template_Mesh_Rearrangement
# This portion of the code is needed to rearrange the point array and the faces in a more convenient way for the construction of the optimization matrix.
lng_3 = ListLength(List=demesh.Vertices)  # -> expr("x-1", Length)
dom = ConstructDomain(DomainStart=0, DomainEnd=lng_3)
range = Range(Domain=dom, Steps=lng_3)
cp_2 = ClosestPoint(Point=merge, Cloud=demesh.Vertices)  # -> flatten(ClosestPoint), CPIndex, Distance
int = Integer(range)
cull_i_8 = CullIndex(List=demesh.Vertices, Indices=flatten(cp_2.CPIndex), Wrap=True)  # -> flatten(List)
cull_i_9 = CullIndex(List=int, Indices=flatten(cp_2.CPIndex), Wrap=True)  # -> flatten(List)
merge_3 = Merge(Data1=cull_i_9, Data2=flatten(cp_2.CPIndex))
sort = SortList(Keys=merge_3, ValuesA=int)  # -> Keys, ValuesA
deface = DeconstructFace(Face=demesh.Faces)  # -> CornerA, CornerB, CornerC, CornerD
merge_4 = Merge(Data1=cull_i_8, Data2=cp_2.ClosestPoint)
item_8 = ListItem(List=sort.ValuesA, Index=deface.CornerA, Wrap=True)
item_9 = ListItem(List=sort.ValuesA, Index=deface.CornerB, Wrap=True)
item_10 = ListItem(List=sort.ValuesA, Index=deface.CornerC, Wrap=True)
triangle = MeshTriangle(CornerA=item_8, CornerB=item_9, CornerC=item_10)

# ---- group: Interpola il campo vettoriale FEM sui punti sintetici come media pesta sui 3 punti più vicini
panel_20 = Panel("FEM nodes")
panel_21 = Panel("ICP Node")
pt_4 = Point(merge_4)
cps = ClosestPoints(Point=pt_4, Cloud=pt_2, Count="5")  # -> ClosestPoint, CPIndex, Distance
panel_22 = Panel("U FEM")
item_11 = ListItem(List=vec.Vector, Index=cps.CPIndex, Wrap=True)
multiplication = Multiplication(A=item_11, B=cps.Distance)
ma = MassAddition(Input=multiplication)  # -> Result, PartialResults
ma_2 = MassAddition(Input=cps.Distance)  # -> Result, PartialResults
division_2 = Division(A=ma.Result, B=ma_2.Result)  # -> flatten(Result)
vec_3 = Vector(flatten(division_2))
addition = Addition(A=pt_4, B=division_2)
vdisex = VectorDisplayEx(Point=pt_4, Vector=flatten(division_2), Colour=RGB(0, 0, 0), Width=2)

# ---- group: W_k (continued)
# No W_k field
# temporary placeolder
lng_4 = ListLength(List=merge_4)
dup = DuplicateData(Data=1, Number=lng_4, Order=True)

# ----
entwine_5 = Entwine(Branch00=dup, Branch01=graph, Branch02=num_2, FlattenInputs=True)  # -> simplify(Result)

# ---- group: Landmark (continued)
vdisex_2 = VectorDisplayEx(Point=cp_2.ClosestPoint, Vector=merge_2, Colour=RGB(0, 0, 0), Width=2)

# ----
branch_3 = TreeBranch(Tree=entwine_5, Path=list_5, MaintainPaths=False)
dam = DataDam(
    DataSourceMeshVer=merge_4,
    DataSourceMeshElem=triangle,
    DataLandmarkUvec=merge_2,
    DataTargetGeometry=branch_2,
    DataAlpha_max=alpha_max,
    DataAlpha_min=alpha_min,
    DataAlpha_step=alpha_step,
    DataEpsilon_step=epsilon_maxstep,
    DataEpsilonThreshold=epsilonthreshold,
    DataWk=branch_3,
    DataCracks=branch,
    DataCracks_influence=cracks_influence,
    BufferDelay=10000000,
    BufferMode=0)  # -> DataSourceMeshVer, DataSourceMeshElem, DataLandmarkUvec, DataTargetGeometry, DataAlpha_max, DataAlpha_min, DataAlpha_step, DataEpsilon_step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
py3 = Python3Script(
    sourceMeshVer=dam.DataSourceMeshVer,
    sourceMeshElem=dam.DataSourceMeshElem,
    landmarkUvec=dam.DataLandmarkUvec,
    targetGeometry=dam.DataTargetGeometry,
    alpha_max=dam.DataAlpha_max,
    alpha_min=dam.DataAlpha_min,
    alpha_step=dam.DataAlpha_step,
    epsilon_maxStep=dam.DataEpsilon_step,
    epsilonThreshold=dam.DataEpsilonThreshold,
    wk=dam.DataWk,
    cracks=dam.DataCracks,
    cracks_influence=dam.DataCracks_influence)  # -> out, UVecExp, Targets, strainsVec, USig_elExp, U_elExp, principalStrainGlobal, eigenSign, simplify(w_r_exp), tempExp; inputs sourceMeshVer: list of Point3d, sourceMeshElem: list, landmarkUvec: list of Vector3d, epsilon_maxStep: Int32, epsilonThreshold: Double, wk: list, cracks: list of Curve, cracks_influence: Double
#   port wk: Optional, default = 1
#   port cracks_influence: 3σ of the crack function. Must be expressed in meters
#   port w_r_exp: the fist branch is just the sum of the others
# ---------- py3: Python ----------
""" 
 _____ _____   _   _                  _       _     _   ___ ____ ____  
|  ___| ____| | \ | | ___  _ __  _ __(_) __ _(_) __| | |_ _/ ___|  _ \ 
| |_  |  _|   |  \| |/ _ \| '_ \| '__| |/ _` | |/ _` |  | | |   | |_) |
|  _| | |___  | |\  | (_) | | | | |  | | (_| | | (_| |  | | |___|  __/ 
|_|   |_____| |_| \_|\___/|_| |_|_|  |_|\__, |_|\__,_| |___\____|_|    
                                        |___/                          
Developed by Giulio Lucio Sergio Sacco under the supervision of Sinan Acikgoz
In Oxford, 2024.
Thanks to Yiyan Liu who provided an implementation of NR ICP (Amberg et al. 2007) algorithm that stated this research.

The code is messy as my bedroom when i was a teenager and it's suposed to run in python3 on Rhino 8 where part of the pre and post processing is performed.

Imputs:
sourceMeshVer       = Rhino points. The points subjected to boundary conditions must be at the end of the list. [V] = [V_free, V_landmark]^T 
sourceMeshElem      = Rhino triangular mesh elements as a list of the 3 vertexes connected indexex (e.g. {123;12;45}). 
LandmarkUvec        = List of displacement vectors, zero or non zero.
targetGeometry      = Target geometry as rhino nurbs, mesh or point cloud
alpha_max           = float
alpha_min           = float
alpha_step          = int -> how many alpha step are required
epsilon_step        = int -> maximum number of epsilon iterations
epsilonThreshhold   = float -> epsilon loop ends if ||U_n - U_n-1|| < epsilonThreshhold
wk                  = the k component of W (W = w * r, 0 < w,r < 1) that represent the reability of the match in the distance term. []
cracks              = 3D curves representing cracks [curve list]

Remember to install all the libraries.
Have fun!
""" 
# requirements: numpy, scipy

import rhinoscriptsyntax as rs
import Rhino as rn
import numpy as np
from scipy import sparse
from scipy import linalg
import math
import ghpythonlib.treehelpers as th

#debug
import sys
import time
#import copy

""" DEBUG """
#GET START TIME
time_start = time.time()
time_start_string = time.strftime("%y-%m-%d %H:%M", time.gmtime(time_start))

#PLOT Status info - Initialization
with open("StatusDebug.txt", "w+") as stf:
    stf.write(f"{time_start_string}\n\n")
    
print("VOMO")

""" INPUT """
# Assign alpha values based on an exponential decay scheme, as suggested by Hasler et al., 2009
alpha = [alpha_max * np.exp(-(1 / alpha_step * np.log(alpha_max / alpha_min)) * i) for i in np.arange(alpha_step)]
# Ensure the last alpha value is exactly the minimum specified
alpha[-1] = alpha_min
epsilon = epsilon_maxStep

if wk == None:
    print("No wk in use")
    wk = 1

""" SEtuP """
source_mesh_vertices = []
for point in sourceMeshVer:  #Conversion of rhino mesh into vertex matrix
    source_mesh_vertices.append([point.X, point.Y, point.Z])
source_mesh_vertices = np.asarray(source_mesh_vertices)

sourceMeshVerLen = len(sourceMeshVer) 

source_mesh_triangles = []
for face in sourceMeshElem: #Conversion of rhino mesh into edges matrix
    source_mesh_triangles.append([face[0], face[1], face[2]])
source_mesh_triangles = np.asarray(source_mesh_triangles)

sourceMeshElemLen = len(sourceMeshElem)

imposed_displacements = []
for vec in landmarkUvec: #Conversion of rhino mesh into edge matrix
    imposed_displacements.append([vec.X, vec.Y, vec.Z])
imposed_displacements = np.asarray(imposed_displacements)

imposed_displacements_Len = len(imposed_displacements)

UVecExp = [] #this is important to initialize the vector
for i in sourceMeshVer:
    UVecExp.append(rs.CreateVector(0, 0, 0))

#B global:
row = []
col = []
data = []
i = 0
for element in source_mesh_triangles:
    v_i = source_mesh_vertices[element[0]]
    v_j = source_mesh_vertices[element[1]]
    v_k = source_mesh_vertices[element[2]]
    
    side1 = v_j - v_i
    side2 = v_k - v_i

    elementAreaInv = np.reciprocal(0.5*np.linalg.norm(np.cross(side1, side2)))
  
    row.append(i*3)
    col.append(i*9)
    data.append(elementAreaInv*(source_mesh_vertices[element[1]][1] - source_mesh_vertices[element[1]][2]))
        
    row.append(i*3)
    col.append(i*9+3)
    data.append(elementAreaInv*(source_mesh_vertices[element[1]][2] - source_mesh_vertices[element[1]][0]))
        
    row.append(i*3)
    col.append(i*9+6)
    data.append(elementAreaInv*(source_mesh_vertices[element[1]][0] - source_mesh_vertices[element[1]][1]))
    
    row.append(i*3+1)
    col.append(i*9+1)
    data.append(elementAreaInv*(source_mesh_vertices[element[0]][2] - source_mesh_vertices[element[0]][1]))
        
    row.append(i*3+1)
    col.append(i*9+4)
    data.append(elementAreaInv*(source_mesh_vertices[element[0]][0] - source_mesh_vertices[element[0]][2]))
        
    row.append(i*3+1)
    col.append(i*9+7)
    data.append(elementAreaInv*(source_mesh_vertices[element[0]][1] - source_mesh_vertices[element[0]][0]))

    row.append(i*3+2)
    col.append(i*9)
    data.append(elementAreaInv*(source_mesh_vertices[element[0]][2] - source_mesh_vertices[element[0]][1]))
       
    row.append(i*3+2)
    col.append(i*9+1)
    data.append(elementAreaInv*(source_mesh_vertices[element[1]][1] - source_mesh_vertices[element[1]][2]))
        
    row.append(i*3+2)
    col.append(i*9+3)
    data.append(elementAreaInv*(source_mesh_vertices[element[0]][0] - source_mesh_vertices[element[0]][2]))
        
    row.append(i*3+2)
    col.append(i*9+4)
    data.append(elementAreaInv*(source_mesh_vertices[element[1]][2] - source_mesh_vertices[element[1]][0]))
        
    row.append(i*3+2)
    col.append(i*9+6)
    data.append(elementAreaInv*(source_mesh_vertices[element[0]][1] - source_mesh_vertices[element[0]][0]))

    row.append(i*3+2)
    col.append(i*9+7)
    data.append(elementAreaInv*(source_mesh_vertices[element[1]][0] - source_mesh_vertices[element[1]][1]))
    
    i += 1

B_Global = sparse.csc_matrix((data, (row, col)), shape=(3*sourceMeshElemLen, 9*sourceMeshElemLen))

# T GLOGAL
Debug1 = []
row = []
col = []
data = []
rowdebug = []
coldebug = []
datadebug = []
i = 0
T_EXP = []
for element in source_mesh_triangles: # T GLOBAL LOOP
   
    #TRIANGOLI RIFERIMENTO ORIGINALI
    v1 = source_mesh_vertices[element[0]]
    v2 = source_mesh_vertices[element[1]]
    v3 = source_mesh_vertices[element[2]]
    
    #VERSOR OF THE ELEMENT COORDINATE SYSTEM
    x = (v2-v1) / np.linalg.norm(v2-v1)
    z = np.cross(v2-v1, v3-v1) / np.linalg.norm(np.cross(v2-v1, v3-v1))
    y = np.cross(z, x) / np.linalg.norm(np.cross(z, x))

    T_EXP.append([x,y,z])#this is needed for the postprocessing of the principal strains

    j = 0 
    for index in element:
        for r in range(3):
                row.append(9*i + 3*j)
                col.append(3*index + r)
                data.append(x[r])

                row.append(9*i + 3*j +1)
                col.append(3*index + r)
                data.append(y[r])

                row.append(9*i + 3*j +2)
                col.append(3*index + r)
                data.append(z[r])                        

                #DEBUG!
                rowdebug.append(9*i + 3*j + r)
                coldebug.append(3*index + r)
                datadebug.append(1)
        j += 1
    i += 1
T_EXP = np.asanyarray(T_EXP)
T_Global = sparse.csc_matrix((data, (row, col)), shape=(9*sourceMeshElemLen, 3*sourceMeshVerLen))

#DEBUG
T_Global_1 = sparse.csc_matrix((datadebug, (rowdebug, coldebug)), shape=(9*sourceMeshElemLen, 3*sourceMeshVerLen))

#COMPLETE GLOBAL FEM MATRIX -> A_FEM
A_FEM = B_Global * T_Global

"""-_-^-_-^-_-^-_-^-_-^-_-^-_-^-_-^-_-^-_-^-_-^-_-^-_-^-_-^"""
# # #      QUESTSO E IL PUNTO IN CUI INIZIA IL LOOP      # # #
"""-_-^-_-^-_-^-_-^-_-^-_-^-_-^-_-^-_-^-_-^-_-^-_-^-_-^-_-^"""

U_increment = [0,0] #initilization of this vector used to break the loop

for alp in alpha: #Alpha loop
    print("alpha:", alp, "and epsilon: ", end="")
    #PLOT Advancements - Alpha
    with open("StatusDebug.txt", "a") as stf:
        stf.write(f"Alpha: {alp}, and epsilon: ")

    for eps in range(epsilon): #Epsilon loop
        
        print(eps, "", end="")
        #PLOT Advancements - Epsilon
        with open("StatusDebug.txt", "a") as stf:
            stf.write(f"{eps}, ")

        new_template = [] #update the oritinal template displacing it by the previous U
        for ver, vec in zip(sourceMeshVer, UVecExp):
            new_template.append(ver + vec)

        #HERE I MISSI THE DEFINITION OF A W_w based on the distances measured here. 
        ww = 1

        target_vertices = [] #New correspondences must be evaluated on the target based on the new template
        if type(targetGeometry) == rn.Geometry.Brep: #Questa cosa può essere riscritta meglio con meno duplicazione
            for point in new_template:
                new_target_vertices_temp = rn.Geometry.Brep.ClosestPoint(targetGeometry, point)
                target_vertices.append([new_target_vertices_temp.X, new_target_vertices_temp.Y, new_target_vertices_temp.Z])
                #tarTempDist.append(new_target_vertices_temp.DistanceTo(point))
            target_vertices = np.asarray(target_vertices)
        elif type(targetGeometry) == rn.Geometry.Mesh:
            for point in new_template:
                new_target_vertices_temp = rn.Geometry.Mesh.ClosestPoint(targetGeometry, point)
                target_vertices.append([new_target_vertices_temp.X, new_target_vertices_temp.Y, new_target_vertices_temp.Z])
                #tarTempDist.append(new_target_vertices_temp.DistanceTo(point))
            target_vertices = np.asarray(target_vertices)
        elif type(targetGeometry) == rn.Geometry.PointCloud:
            #sys.exit("The use of point cloud as target is not supported yet. Just mesh it.")
            for point in new_template:
                new_target_vertices_index_temp = rn.Geometry.PointCloud.ClosestPoint(targetGeometry, point)
                new_target_vertices_temp = targetGeometry[new_target_vertices_index_temp]
                target_vertices.append([new_target_vertices_temp.X, new_target_vertices_temp.Y, new_target_vertices_temp.Z])
            target_vertices = np.asarray(target_vertices)
        else:
            print("Your impus is a",  type(targetGeometry))
            sys.exit("Give me proper data! I need a brep, mesh or point cloud.")
        #W vector (or a scalar if both ww and wk are scalars). 
        W = ww * wk

        #A_Dist: NB: this is just a huge I_(3*templateVertexes) scaled by W(w,r) !!! THIS example must be used to simplyty other constructions of I like matrixes.
        A_Dist = sparse.csc_matrix((np.repeat(W, 3), (np.arange(3*sourceMeshVerLen), np.arange(3*sourceMeshVerLen))), shape=(3*sourceMeshVerLen, 3*sourceMeshVerLen))
        
        #A matrix
        A = sparse.vstack([alp * A_FEM, A_Dist], format="csc")
        
        #B_f
        vFlatten = (source_mesh_vertices).flatten()
        uFlatten = (target_vertices).flatten()
        uTarget = np.repeat(W, 3) * (uFlatten - vFlatten) # Moltiplicare tutto per W inq uesto punto dovrebbe funzionare perché dovrebbero avere tutti la stessa lunghezza? Forse.

        row = []
        col = []
        data = []
        i = 0
        breaker = (3*sourceMeshElemLen + 3*(sourceMeshVerLen-imposed_displacements_Len))
        for U_component in uTarget:
            row.append(3*sourceMeshElemLen + i)
            col.append(0)
            data.append(U_component)
            i += 1
            if (3*sourceMeshElemLen + i) == breaker:
                break
        B_f = sparse.csc_matrix((data, (row, col)), shape=(3*sourceMeshElemLen + 3*(sourceMeshVerLen-imposed_displacements_Len), 1))

        #A_ff
        A_ff = A[:A.get_shape()[0] - imposed_displacements_Len*3, :A.get_shape()[1] - imposed_displacements_Len*3]

        #A_fl
        A_fl = A[:A.get_shape()[0] - imposed_displacements_Len*3, A.get_shape()[1] - imposed_displacements_Len*3:]

        #U_l
        row = []
        col = []
        data = []
        i = 0
        imposed_displacements_flat = imposed_displacements.flatten()
        for component in imposed_displacements_flat:
            row.append(i)
            col.append(0)
            data.append(component)
            i += 1
        U_l = sparse.csc_matrix((data, (row, col)), shape=(3*imposed_displacements_Len, 1))

        #B_tilde
        Bilde = B_f - A_fl*U_l

        #SOLVE! linalg.lsmr() is suposed to be faster, but I'm not sure
        U, istop, itn, normt = sparse.linalg.lsqr(A_ff, Bilde.toarray().flatten(), atol=1e-6)[:4]
       
        UExp = U.reshape((sourceMeshVerLen-imposed_displacements_Len, 3))
        
        UVecExp = [] #this is used to compute the next template
        for point in UExp:
            UVecExp.append(rs.CreateVector(point[0], point[1], point[2]))
        UVecExp.extend(landmarkUvec)

        U_increment[1] = np.linalg.norm(U)
        if abs(U_increment[0]-U_increment[1]) < epsilonThreshold:
            U_increment[0] = 0
            U_increment[1] = 0
            print("")
            break

        if eps == epsilon-1:
            print("")
            U_increment[0] = 0
            U_increment[1] = 0
        else:
            U_increment[0] = U_increment[1]
    #PLOT Advancements - new row
    with open("StatusDebug.txt", "a") as stf:
        stf.write(f"DONE!\n")

new_template = [] #update the oritinal template displacing it by the previous U
for ver, vec in zip(sourceMeshVer, UVecExp):
    new_template.append(ver + vec)

#CENTROID OF DEFORMED FACES
newElementCentroid = []
for element in sourceMeshElem:
    newElementCentroid.append((new_template[element[0]] + new_template[element[1]] + new_template[element[2]])/3)

#PLOT Advancements - Intermezzo
with open("StatusDebug.txt", "a") as stf:
    stf.write(f"\nSECOND LOOP \n\n")

#Second iteration adding cracks 
if cracks == None:
    print("You are a lazy ass! Implement cracks! It's free.")
else:
    print("Second Iretation with cracks")
    tmpfuck = 1/(cracks_influence/3)
    wr = np.zeros([len(cracks)+1, sourceMeshElemLen]) #the data structure is [[global w_r][crack_1 w_r]...[crack_n w_r]] so to be easily loopable
    cv = 0
    for curve in cracks:
        pt = 0
        for i in newElementCentroid:
            r, t = curve.ClosestPoint(i)
            ptOnCurve = curve.PointAt(t)
            dist = i.DistanceTo(ptOnCurve)
            wr[cv+1, pt] = math.exp( - pow(tmpfuck * dist, 2)) #Crack function
            wr[0, pt] += wr[cv+1, pt] #This should be limited between 0 and +1!
            pt += 1
        cv +=1
    wr = 1-wr #it's better to do this here because in this way it's easier to sum up the single crack r 
    
    #Output the lists for postprocessing of crack width or something
    w_r_exp = th.list_to_tree(np.ndarray.tolist(wr), source=[0,0]) #This is practicaly black magic to convert a numpy array into a grashopper tree

    """-_-^-_-^-_-^-_-^-_-^-_-^-_-^-_-^-_-^-_-^-_-^-_-^-_-^-_-^""" #DIOBUG
    """-_-^-_-^-_-^-_-^-_-^-_-^-_-^-_-^-_-^-_-^-_-^-_-^-_-^-_-^""" #DIOBUG
    """-_-^-_-^-_-^-_-^-_-^-_-^-_-^-_-^-_-^-_-^-_-^-_-^-_-^-_-^""" #DIOBUG
    """-_-^-_-^-_-^-_-^-_-^-_-^-_-^-_-^-_-^-_-^-_-^-_-^-_-^-_-^""" #DIOBUG

    alphaVec = wr[0, :]

    U_increment = [0,0] #initilization of this vector used to break the loop
    for alp in alpha: #Alpha loop
        print("alpha:", alp, "and epsilon: ", end="")
        #PLOT Advancements - Alpha
        with open("StatusDebug.txt", "a") as stf:
            stf.write(f"Alpha: {alp}, and epsilon: ")

        a_alphaCrack = alphaVec * alp
        a_alphar = sparse.csc_matrix((np.repeat(a_alphaCrack, 3), (np.arange(3*sourceMeshElemLen), np.arange(3*sourceMeshElemLen))), shape=(3*sourceMeshElemLen, 3*sourceMeshElemLen))

        for eps in range(epsilon): #Epsilon loop
            
            print(eps, "", end="")
            #PLOT Advancements - Epsilon
            with open("StatusDebug.txt", "a") as stf:
                stf.write(f"{eps}, ")

            new_template = [] #update the oritinal template displacing it by the previous U
            for ver, vec in zip(sourceMeshVer, UVecExp):
                new_template.append(ver + vec)

            #HERE I MISSI THE DEFINITION OF A W_w based on the distances measured here. 
            ww = 1

            target_vertices = [] #New correspondences must be evaluated on the target based on the new template
            if type(targetGeometry) == rn.Geometry.Brep: #Questa cosa può essere riscritta meglio con meno duplicazione
                for point in new_template:
                    new_target_vertices_temp = rn.Geometry.Brep.ClosestPoint(targetGeometry, point)
                    target_vertices.append([new_target_vertices_temp.X, new_target_vertices_temp.Y, new_target_vertices_temp.Z])
                    #tarTempDist.append(new_target_vertices_temp.DistanceTo(point))
                target_vertices = np.asarray(target_vertices)
            elif type(targetGeometry) == rn.Geometry.Mesh:
                for point in new_template:
                    new_target_vertices_temp = rn.Geometry.Mesh.ClosestPoint(targetGeometry, point)
                    target_vertices.append([new_target_vertices_temp.X, new_target_vertices_temp.Y, new_target_vertices_temp.Z])
                    #tarTempDist.append(new_target_vertices_temp.DistanceTo(point))
                target_vertices = np.asarray(target_vertices)
            elif type(targetGeometry) == rn.Geometry.PointCloud:
                for point in new_template:
                    new_target_vertices_index_temp = rn.Geometry.PointCloud.ClosestPoint(targetGeometry, point)
                    new_target_vertices_temp = targetGeometry[new_target_vertices_index_temp]
                    target_vertices.append([new_target_vertices_temp.X, new_target_vertices_temp.Y, new_target_vertices_temp.Z])
                target_vertices = np.asarray(target_vertices)
            else:
                print("Your impus is a",  type(targetGeometry))
                sys.exit("Give me proper data! I need a brep, mesh or point cloud.")
            #W vector (or a scalar if both ww and wk are scalars). 
            W = ww * wk

            #A_Dist: NB: this is just a huge I_(3*templateVertexes) scaled by W(w,r) !!! THIS example must be used to simplyty other constructions of I like matrixes.
            A_Dist = sparse.csc_matrix((np.repeat(W, 3), (np.arange(3*sourceMeshVerLen), np.arange(3*sourceMeshVerLen))), shape=(3*sourceMeshVerLen, 3*sourceMeshVerLen))
            
            #A matrix
            """
            print("DIOCAN")
            print("a_alphar", sparse.linalg.norm(a_alphar))
            print("A_FEM", sparse.linalg.norm(A_FEM))
            print("a_alphar @ A_FEM", sparse.linalg.norm(a_alphar @ A_FEM))
            """
            A = sparse.vstack([a_alphar @ A_FEM, A_Dist], format="csc")#alp * A_FEM
            
            #B_f
            vFlatten = (source_mesh_vertices).flatten()
            uFlatten = (target_vertices).flatten()
            uTarget = np.repeat(W, 3) * (uFlatten - vFlatten) # Moltiplicare tutto per W inq uesto punto dovrebbe funzionare perché dovrebbero avere tutti la stessa lunghezza? Forse.

            row = []
            col = []
            data = []
            i = 0
            breaker = (3*sourceMeshElemLen + 3*(sourceMeshVerLen-imposed_displacements_Len))
            for U_component in uTarget:
                row.append(3*sourceMeshElemLen + i)
                col.append(0)
                data.append(U_component)
                i += 1
                if (3*sourceMeshElemLen + i) == breaker:
                    break
            B_f = sparse.csc_matrix((data, (row, col)), shape=(3*sourceMeshElemLen + 3*(sourceMeshVerLen-imposed_displacements_Len), 1))

            #A_ff
            A_ff = A[:A.get_shape()[0] - imposed_displacements_Len*3, :A.get_shape()[1] - imposed_displacements_Len*3]

            #A_fl
            A_fl = A[:A.get_shape()[0] - imposed_displacements_Len*3, A.get_shape()[1] - imposed_displacements_Len*3:]

            #U_l
            row = []
            col = []
            data = []
            i = 0
            imposed_displacements_flat = imposed_displacements.flatten()
            for component in imposed_displacements_flat:
                row.append(i)
                col.append(0)
                data.append(component)
                i += 1
            U_l = sparse.csc_matrix((data, (row, col)), shape=(3*imposed_displacements_Len, 1))

            #B_tilde
            Bilde = B_f - A_fl*U_l

            #SOLVE! linalg.lsmr() is suposed to be faster, but I'm not sure
            U, istop, itn, normt = sparse.linalg.lsqr(A_ff, Bilde.toarray().flatten(), atol=1e-6)[:4]
        
            UExp = U.reshape((sourceMeshVerLen-imposed_displacements_Len, 3))
            
            UVecExp = [] #this is used to compute the next template
            for point in UExp:
                UVecExp.append(rs.CreateVector(point[0], point[1], point[2]))
            UVecExp.extend(landmarkUvec)

            U_increment[1] = np.linalg.norm(U)
            if abs(U_increment[0]-U_increment[1]) < epsilonThreshold:
                U_increment[0] = 0
                U_increment[1] = 0
                print("")
                break

            if eps == epsilon-1:
                print("")
                U_increment[0] = 0
                U_increment[1] = 0
            else:
                U_increment[0] = U_increment[1]
        #PLOT Advancements - new row
        with open("StatusDebug.txt", "a") as stf:
            stf.write(f"DONE!\n")



    """-_-^-_-^-_-^-_-^-_-^-_-^-_-^-_-^-_-^-_-^-_-^-_-^-_-^-_-^""" #END DIOBUG




"""-_-^-_-^-_-^-_-^-_-^-_-^-_-^-_-^-_-^-_-^-_-^-_-^-_-^-_-^"""
# # #                   POST PROCESSING                  # # #
"""-_-^-_-^-_-^-_-^-_-^-_-^-_-^-_-^-_-^-_-^-_-^-_-^-_-^-_-^"""

Targets = [] #TEMPORARY DEBUG
for point in target_vertices:
    Targets.append(rs.CreatePoint(point[0], point[1], point[2]))

#FINAL TIME TAG
time_end = time.time()
"""
#DeBuGGoNe
USig_el = T_Global[:,:3*(sourceMeshVerLen-imposed_displacements_Len)] @ U
U_el = T_Global_1[:,:3*(sourceMeshVerLen-imposed_displacements_Len)] @ U

USig_el = USig_el.reshape((len(USig_el)//3, 3))
USig_elExp = []
for point in USig_el:
     USig_elExp.append(rs.CreateVector(point[0], point[1], point[2]))

U_el = U_el.reshape((len(U_el)//3, 3))
UExp = U.reshape((sourceMeshVerLen-imposed_displacements_Len, 3))
U_elExp = []
for point in U_el:
    U_elExp.append(rs.CreateVector(point[0], point[1], point[2]))
### ^ ???
"""
U_Strains = []
for vec in UVecExp: #This is silly. it was made like that for programming convenience, but it's obviouly bad for performance
    U_Strains.append(vec.X)
    U_Strains.append(vec.Y)
    U_Strains.append(vec.Z)
    
strains = A_FEM * U_Strains #this is what it looks, plus reshaping to have a neat data structure of v^T stacked vertically 
strains = strains.reshape((sourceMeshElemLen, 3))

strainTensor = [] #Just 2x2 plane strain tensor: [E_xx, 1/2 gamma_xy][1/2 gamma_xy, E_yy]
for vector in strains:
    strainTensor.append([[vector[0], 0.5*vector[2]],[0.5*vector[2],vector[1]]])

principalStrainLocal = [] #Here the eigen problem is solved to have principal strains as vectors (lambda*V) arranged as as column vectors as it should be.
eigenSign = []
for tensor in strainTensor:
    eigenval, eigenvec = linalg.eig(tensor) #magic *-*
    eigenval = eigenval.real #Fuck the imaginary part which is 0
    eigenSign.append(np.sign(eigenval[0]))
    eigenSign.append(np.sign(eigenval[1]))
    principalStrainLocal.append([[eigenval[0]*eigenvec[0,0],eigenval[1]*eigenvec[0,1],0],[eigenval[0]*eigenvec[1,0],eigenval[1]*eigenvec[1,1],0],[0,0,0]])
principalStrainLocal = np.asarray(principalStrainLocal)

principalStrainGlobal = [] #Those are arranged in a list of [[E_1, E_2],...,[E_1, E_2]] to be displayed on rhino on the centroids of elements.
for matrix, Texp in zip(principalStrainLocal, T_EXP):
    PSG = Texp.transpose() @ matrix
    principalStrainGlobal.append(rs.CreateVector(PSG[0,0], PSG[1,0], PSG[2,0]))
    principalStrainGlobal.append(rs.CreateVector(PSG[0,1], PSG[1,1], PSG[2,1])) #Here I'm outputting the vectors

#??? #TO BE SCRAPPED DEBUG
strainsVec = []
for elem in strains:
    strainsVec.append(rs.CreateVector(elem[0], elem[1], elem[2]))

print("Final solution! End reason:", istop, "number iterations:", itn, "norm(b - Ax) =", normt)
print("Total elapsed time:", round(time_end - time_start,2), "seconds")
print("Thanks fur the consideration, and all the fish. 🐬")
# ---------- end py3 ----------
panel_24 = Panel(py3.out)
addition_2 = Addition(A=dam.DataSourceMeshVer, B=py3.UVecExp)
pt_5 = Point(py3.Targets)
split_2 = SplitTree(Data=py3.w_r_exp, Masks=flatten("{0}"))  # -> Positive, Negative
gradient_4 = Gradient(LowerLimit=0, UpperLimit=1, Parameter=split_2.Positive, stops=[0: RGB(255, 0, 0), 1: RGB(0, 128, 0)])
cloud_4 = ConstructCloud(Points=dam.DataSourceMeshVer, Colors=gradient_4)
dam_2 = DataDam(
    DataA=vec.Vector,
    DataB=move.Geometry,
    DataC=division_2,
    DataD=addition,
    DataE=py3.UVecExp,
    DataF=addition_2,
    BufferDelay=10000000,
    BufferMode=0)  # -> DataA, DataB, DataC, DataD, DataE, DataF

bnd_3 = Bounds(Numbers=dam_2.DataA)
dedomain_2 = DeconstructDomain(Domain=bnd_3)  # -> Start, End
abs_3 = Absolute(Value=dedomain_2.Start)
abs_4 = Absolute(Value=dedomain_2.End)
max_2 = Maximum(A=abs_3, B=abs_4)
panel_25 = Panel(max_2)
panel_26 = Panel("0.01")
multiplication_2 = Multiplication(A=panel_25, B=-1)
merge_5 = Merge(Data1=dam_2.DataA, Data2=panel_25)  # -> flatten(Result)
gradient_5 = Gradient(
    LowerLimit=expr("X*-1", "0"),
    UpperLimit=panel_25,
    Parameter=dam_2.DataA,
    stops=[0: RGB(0, 0, 255), 0.25: RGB(0, 255, 255), 0.5: RGB(0, 255, 0), 0.75: RGB(255, 255, 0), 1: RGB(255, 0, 0)])
num_3 = Number(merge_5)
expression = Expression(x=num_3, Expression="If(x < 0, -1, +1)")
expression_2 = Expression(x=num_3, y=expression, Expression="if(x>100, 100*y, x)")
bar_graph_3 = BarGraph(expression_2, BarColor=RGB(255, 132, 0))
cloud_5 = ConstructCloud(Points=dam_2.DataB, Colors=gradient_5)

cdel = DelaunayColored(Cloud=cloud_5, Plane=PlaneXY(0, 0, 0))

vec_4 = Vector(flatten(dam_2.DataC))
bnd_4 = Bounds(Numbers=vec_4)
dedomain_3 = DeconstructDomain(Domain=bnd_4)  # -> Start, End
abs_5 = Absolute(Value=dedomain_3.Start)
abs_6 = Absolute(Value=dedomain_3.End)
max_3 = Maximum(A=abs_5, B=abs_6)
panel_27 = Panel(max_3)
merge_6 = Merge(Data1=vec_4, Data2=panel_25)  # -> flatten(Result)
gradient_6 = Gradient(
    LowerLimit=expr("X*-1", "0"),
    UpperLimit=panel_25,
    Parameter=vec_4,
    stops=[0: RGB(0, 0, 255), 0.25: RGB(0, 255, 255), 0.5: RGB(0, 255, 0), 0.75: RGB(255, 255, 0), 1: RGB(255, 0, 0)])
num_4 = Number(merge_6)
expression_3 = Expression(x=num_4, Expression="If(x < 0, -1, +1)")
expression_4 = Expression(x=num_4, y=expression_3, Expression="if(x>100, 100*y, x)")
bar_graph_4 = BarGraph(expression_4, BarColor=RGB(255, 132, 0))
cloud_6 = ConstructCloud(Points=dam_2.DataD, Colors=gradient_6)

mesh_4 = Mesh(cdel)
cdel_2 = DelaunayColored(Cloud=cloud_6, Plane=PlaneXY(0, 0, 0))
mesh_5 = Mesh(cdel_2)

# ---- group: Debug (Last Closest Points)
pt_6 = Point(py3.Targets)
vec2pt_2 = Vector2Pt(PointA=dam.DataSourceMeshVer, PointB=pt_6, Unitize=False)  # -> Vector, Length
addition_3 = Addition(A=dam.DataSourceMeshVer, B=vec2pt_2.Vector)
conmesh = ConstructMesh(Vertices=addition_3, Faces=triangle)

# ----
bnd_5 = Bounds(Numbers=dam_2.DataE)
dedomain_4 = DeconstructDomain(Domain=bnd_5)  # -> Start, End
abs_7 = Absolute(Value=dedomain_4.Start)
abs_8 = Absolute(Value=dedomain_4.End)
max_4 = Maximum(A=abs_7, B=abs_8)
panel_29 = Panel(max_4)
merge_7 = Merge(Data1=dam_2.DataE, Data2=panel_25)  # -> flatten(Result)
gradient_7 = Gradient(
    LowerLimit=expr("X*-1", "0"),
    UpperLimit=panel_25,
    Parameter=dam_2.DataE,
    stops=[0: RGB(0, 0, 255), 0.25: RGB(0, 255, 255), 0.5: RGB(0, 255, 0), 0.75: RGB(255, 255, 0), 1: RGB(255, 0, 0)])
num_5 = Number(merge_7)
expression_5 = Expression(x=num_5, Expression="If(x < 0, -1, +1)")
expression_6 = Expression(x=num_5, y=expression_5, Expression="if(x>100, 100*y, x)")
bar_graph_5 = BarGraph(expression_6, BarColor=RGB(255, 132, 0))
cloud_7 = ConstructCloud(Points=dam_2.DataF, Colors=gradient_7)

# ---- group: Debug (Last Closest Points) / CP_Collapse
medges_3 = MeshEdges(Mesh=conmesh)  # -> NakedEdges, InteriorEdges, NonManifoldEdges
vdisex_3 = VectorDisplayEx(Point=dam.DataSourceMeshVer, Vector=vec2pt_2.Vector, Colour=RGB(0, 0, 0), Width=2)

# ----
cdel_3 = DelaunayColored(Cloud=cloud_7, Plane=PlaneXY(0, 0, 0))
mesh_6 = Mesh(cdel_3)

# ---- group: Cracks
crv_6 = Curve(branch)
reb = RebuildCurve(Curve=crv_6, Degree="2", Count="50", Tangents=False)
divide = DivideCurve(Curve=reb, Count="36", Kinks=False)  # -> Points, Tangents, Parameters
eval = EvaluateCurve(Curve=graft(reb), Parameter=simplify(divide.Parameters))  # -> Point, Tangent, Angle

# Crack width is computed as the difference between the average normal displacement fields of couple of points take on two side of a crack.
# The direction of the carck opening is shown alongside the lenght.
# Debuggato fino a questo punto
number_slider_7 = Slider(7, range=0..8)
multiplication_3 = Multiplication(A=dam.DataCracks_influence, B=number_slider_7, C=0.3333333333)
panel_30 = Panel("""1
-1""")

panel_31 = Panel(multiplication_3)
circle = CircleCNR(Center=simplify(eval.Point), Normal=simplify(eval.Tangent), Radius=panel_31)

# ----
panel_32 = Panel("Direction")
xy = XYPlane(Origin=Point(0, 0, 0))
rotate = Rotate(Geometry=xy, Angle=degrees(number_slider), Plane=PlaneXY(0, 0, 0))  # -> Geometry, Transform
deplane = DeconstructPlane(Plane=rotate.Geometry)  # -> Origin, XAxis, YAxis, ZAxis
X = UnitX(Factor=1)
Y = UnitY(Factor=1)
Z = UnitZ(Factor=1)
merge_8 = Merge(Data1=X, Data2=Y, Data3=Z, Data4=deplane.XAxis, Data5=deplane.YAxis, Data6=deplane.ZAxis)
item_12 = ListItem(List=merge_8, Index=list_3, Wrap=True)

panel_34 = Panel(item_12)
dprod = DotProduct(VectorA=py3.UVecExp, VectorB=item_12, Unitize=False)

# ---- group: Principal Strains
# Here the principal strains are displayed mostly for debug purposes.
vlen = VectorLength(Vector=py3.principalStrainGlobal)
panel_35 = Panel("Vectors")
panel_37 = Panel("Sign")
multiplication_4 = Multiplication(A=py3.eigenSign, B=vlen)
dispatch = Dispatch(List=multiplication_4, DispatchPattern=[True, False])  # -> simplify(graft(ListA)), simplify(graft(ListB))
dispatch_2 = Dispatch(List=py3.principalStrainGlobal, DispatchPattern=[True, False])  # -> simplify(graft(ListA)), simplify(graft(ListB))
dispatch_3 = Dispatch(List=py3.eigenSign, DispatchPattern=[True, False])  # -> simplify(graft(ListA)), simplify(graft(ListB))
panel_38 = Panel("""placeholder
true
false""")
panel_39 = Panel("""placeholder
true
false""")
merge_9 = Merge(Data1=dispatch.ListA, Data2=dispatch.ListB)
merge_10 = Merge(Data1=dispatch_2.ListA, Data2=dispatch_2.ListB)
merge_11 = Merge(Data1=dispatch_3.ListA, Data2=dispatch_3.ListB)
sort_2 = SortList(Keys=merge_9, ValuesB=merge_10, ValuesA=merge_11)  # -> flatten(Keys), flatten(ValuesB), flatten(ValuesA)
multiplication_5 = Multiplication(A=sort_2.ValuesB, B=number_slider_2)
dispatch_4 = Dispatch(List=multiplication_5, DispatchPattern=[True, False])  # -> ListA, ListB
dispatch_5 = Dispatch(List=sort_2.ValuesA, DispatchPattern=[True, False])  # -> ListA, ListB
item_13 = ListItem(List=panel_39, Index=dispatch_5.ListA, Wrap=True)
item_14 = ListItem(List=panel_38, Index=dispatch_5.ListB, Wrap=True)
panel_40 = Panel("""maximum
vectors""")
panel_41 = Panel("""maximum
points""")
panel_42 = Panel("""minimum
vectors""")
panel_43 = Panel("""minimum
points""")
dispatch_6 = Dispatch(List=dispatch_4.ListA, DispatchPattern=item_13)  # -> ListA, ListB
dispatch_7 = Dispatch(List=dispatch_4.ListB, DispatchPattern=item_14)  # -> ListA, ListB
multiplication_6 = Multiplication(A=dispatch_6.ListA, B=-1)
multiplication_7 = Multiplication(A=dispatch_6.ListB, B=-1)
multiplication_8 = Multiplication(A=dispatch_7.ListA, B=-1)
multiplication_9 = Multiplication(A=dispatch_7.ListB, B=-1)
merge_12 = Merge(Data1=graft(dispatch_6.ListA), Data2=graft(multiplication_6))  # -> simplify(Result)
merge_13 = Merge(Data1=graft(dispatch_6.ListB), Data2=graft(multiplication_7))  # -> simplify(Result)
merge_14 = Merge(Data1=graft(dispatch_7.ListA), Data2=graft(multiplication_8))  # -> simplify(Result)
merge_15 = Merge(Data1=graft(dispatch_7.ListB), Data2=graft(multiplication_9))  # -> simplify(Result)
swatch = ColourSwatch(SwatchColor=RGB(255, 0, 0))
swatch_2 = ColourSwatch(SwatchColor=RGB(0, 42, 255))
panel_44 = Panel("compression")
panel_46 = Panel("traction")
multiplication_10 = Multiplication(A=merge_13, B=-1)
multiplication_11 = Multiplication(A=merge_15, B=-1)

# ----
bnd_6 = Bounds(Numbers=py3.UVecExp)
stats = Statistics(Series=py3.UVecExp)  # -> SampleMean, Median, Average, StandardDeviation, Skewness, Kurtosis, Variance
dedomain_5 = DeconstructDomain(Domain=bnd_6)  # -> Start, End
abs_9 = Absolute(Value=dedomain_5.Start)
abs_10 = Absolute(Value=dedomain_5.End)
max_5 = Maximum(A=abs_9, B=abs_10)
panel_48 = Panel(stats.SampleMean)
panel_49 = Panel(max_5)
merge_16 = Merge(Data1=py3.UVecExp, Data2=number_slider_5, Data3="0")  # -> flatten(Result)
gradient_8 = Gradient(
    LowerLimit=expr("X*-1", "0"),
    UpperLimit=number_slider_5,
    Parameter=py3.UVecExp,
    stops=[0: RGB(0, 128, 0), 0.5: RGB(255, 255, 0), 1: RGB(255, 0, 0)])
num_6 = Number(merge_16)
expression_7 = Expression(x=num_6, Expression="If(x < 0, -1, +1)")
expression_8 = Expression(x=num_6, y=expression_7, Expression="if(x>100, 100*y, x)")
cloud_8 = ConstructCloud(Points=addition_2, Colors=gradient_8)

conmesh_2 = ConstructMesh(Vertices=addition_2, Faces=dam.DataSourceMeshElem, Colours=gradient_8)
medges_4 = MeshEdges(Mesh=conmesh_2)  # -> NakedEdges, InteriorEdges, NonManifoldEdges

# ---- group: Principal Strains (continued)
faceb = FaceBoundaries(Mesh=conmesh_2)
area_2 = Area(Geometry=faceb)  # -> Area, Centroid
dispatch_8 = Dispatch(List=area_2.Centroid, DispatchPattern=item_13)  # -> ListA, ListB
dispatch_9 = Dispatch(List=area_2.Centroid, DispatchPattern=item_14)  # -> ListA, ListB
pt_7 = Point(dispatch_8.ListA)
pt_8 = Point(dispatch_8.ListB)
move_2 = Move(Geometry=simplify(graft(dispatch_8.ListB)), Motion=merge_13)  # -> Geometry, Transform
move_3 = Move(Geometry=simplify(graft(dispatch_9.ListB)), Motion=merge_15)  # -> Geometry, Transform

# ----
panel_50 = Panel(stats.StandardDeviation)
panel_51 = Panel(stats.Variance)
expression_9 = Expression(x=num_6, y=number_slider_5, Expression="If(x < -y, -y, if(x > y, y, x))")

bar_graph_6 = BarGraph(expression_9, BarColor=RGB(255, 132, 0))

# ---- group: Area Variation
area_3 = Area(Geometry=meshrepair)  # -> Area, Centroid
area_4 = Area(Geometry=conmesh_2)  # -> Area, Centroid
expression_10 = Expression(x=area_3.Area, y=area_4.Area, Expression="abs(x-y)/x")
panel_52 = Panel(expression_10)

area_5 = Area(Geometry=tri.Mesh)  # -> Area, Centroid
area_6 = Area(Geometry=conmesh_2)  # -> Area, Centroid
expression_11 = Expression(x=area_5.Area, y=area_6.Area, Expression="abs(x-y)/x")
panel_53 = Panel(expression_11)

# ---- group: U_FE_ICP
cluster = Cluster_2(relay=addition_2, relay_2=dam.DataSourceMeshVer)  # -> planw, T, R
mesh_7 = Mesh(conmesh_2)
crv_7 = Curve(cluster.R)
medges_5 = MeshEdges(Mesh=mesh_7)  # -> NakedEdges, InteriorEdges, NonManifoldEdges
mesh_8 = Mesh(conmesh_2)
vdisex_4 = VectorDisplayEx(Point=dam.DataSourceMeshVer, Vector=py3.UVecExp, Colour=ColourSwatch(SwatchColor=RGB(255, 119, 0)), Width=2)
tag = TextTag3D(Location=cluster.planw, Text=cluster.T, Size="0.01", Justification=7)

# ---- group: Cracks (continued)
mcx = MeshCurve(Mesh=mesh_7, Curve=circle)  # -> simplify(Points), Faces
prune = PruneTree(Tree=mcx.Points, Minimum="2", Maximum=0)

item_15 = ListItem(List=prune, Index=0, Wrap=True)
item_16 = ListItem(List=prune, Index=1, Wrap=True)
vec2pt_3 = Vector2Pt(PointA=item_15, PointB=item_16, Unitize=False)  # -> Vector, Length
vdisex_5 = VectorDisplayEx(Point=item_15, Vector=vec2pt_3.Vector, Colour=RGB(0, 0, 0), Width=2)

medges_6 = MeshEdges(Mesh=conmesh_2)  # -> NakedEdges, InteriorEdges, NonManifoldEdges
ma_3 = MassAddition(Input=prune)  # -> Result, PartialResults
division_3 = Division(A=ma_3.Result, B=2)
cps_2 = ClosestPoints(Point=prune, Cloud=addition_2, Count="5")  # -> ClosestPoint, CPIndex, Distance
item_17 = ListItem(List=py3.UVecExp, Index=cps_2.CPIndex, Wrap=True)
ma_4 = MassAddition(Input=item_17)  # -> Result, PartialResults
division_4 = Division(A=ma_4.Result, B="5")
unit = UnitVector(Vector=vec2pt_3.Vector)
trim_2 = TrimTree(Tree=division_4, Depth=1)
dprod_2 = DotProduct(VectorA=graft(unit), VectorB=trim_2, Unitize=False)
multiplication_12 = Multiplication(A=graft(unit), B=dprod_2, C=panel_30)
item_18 = ListItem(List=multiplication_12, Index=0, Wrap=True)
item_19 = ListItem(List=multiplication_12, Index=1, Wrap=True)
vdisex_6 = VectorDisplayEx(Point=item_16, Vector=expr("x*-1", item_19), Colour=RGB(0, 0, 0), Width=2)
vdisex_7 = VectorDisplayEx(Point=item_15, Vector=item_18, Colour=RGB(0, 0, 0), Width=2)
ma_5 = MassAddition(Input=multiplication_12)  # -> Result, PartialResults
vlen_2 = VectorLength(Vector=ma_5.Result)
multiplication_13 = Multiplication(A=vlen_2, B="1000")
format = Format(Format="{0:0.00} mm", Culture=127, Data0=flatten(multiplication_13))
vdisex_8 = VectorDisplayEx(Point=division_3, Vector=multiplication_12, Colour=RGB(0, 0, 0), Width=2)
panel_54 = Panel(ma_5.Result)
multiplication_14 = Multiplication(A=ma_5.Result, B=Slider(314, range=0..1000))
panel_55 = Panel(multiplication_12)
annotation_dot = AnnotationDot(Location=flatten(division_3), PrimaryText=flatten(format))  # -> AnnotationDot, Location, PrimaryText, TextHeight
vdisex_9 = VectorDisplayEx(Point=division_3, Vector=multiplication_14, Colour=RGB(0, 0, 0), Width=2)

# ----
bnd_7 = Bounds(Numbers=dprod)
stats_2 = Statistics(Series=dprod)  # -> SampleMean, Median, Average, StandardDeviation, Skewness, Kurtosis, Variance
dedomain_6 = DeconstructDomain(Domain=bnd_7)  # -> Start, End
abs_11 = Absolute(Value=dedomain_6.Start)
abs_12 = Absolute(Value=dedomain_6.End)
max_6 = Maximum(A=abs_11, B=abs_12)
panel_56 = Panel(stats_2.SampleMean)
panel_57 = Panel(max_6)

panel_58 = Panel(stats_2.Variance)
panel_59 = Panel(stats_2.StandardDeviation)
cluster_2 = Cluster(d1=number_slider_3, A=panel_57, B=number_slider_4, i=list_4)
multiplication_15 = Multiplication(A=cluster_2, B=-1)

gradient_9 = Gradient(
    LowerLimit=expr("X*-1", cluster_2),
    UpperLimit=cluster_2,
    Parameter=dprod,
    stops=[0: RGB(0, 0, 255), 0.25: RGB(192, 255, 255), 0.5: RGB(0, 128, 0), 0.75: RGB(255, 255, 0), 1: RGB(255, 0, 0)])
merge_17 = Merge(Data1=dprod, Data2=cluster_2, Data3=multiplication_15)  # -> flatten(Result)
num_7 = Number(merge_17)
expression_12 = Expression(x=num_7, y=cluster_2, Expression="If(x < -y, -y, if(x > y, y, x))")
bar_graph_7 = BarGraph(expression_12, BarColor=RGB(255, 132, 0))
expression_13 = Expression(x=num_7, y=expression_12, Expression="if(x>100, 100*y, x)")
cloud_9 = ConstructCloud(Points=addition_2, Colors=gradient_9)

panel_60 = Panel(cluster_2)

vdisex_10 = VectorDisplayEx(Point=simplify(graft(dispatch_8.ListA)), Vector=merge_12, Colour=swatch_2, Width=2)
vdisex_11 = VectorDisplayEx(Point=simplify(graft(dispatch_9.ListA)), Vector=merge_14, Colour=swatch, Width=2)
medges_7 = MeshEdges(Mesh=conmesh_2)  # -> NakedEdges, InteriorEdges, NonManifoldEdges
conmesh_3 = ConstructMesh(Vertices=addition_2, Faces=dam.DataSourceMeshElem, Colours=gradient_8)
conmesh_4 = ConstructMesh(Vertices=addition_2, Faces=dam.DataSourceMeshElem, Colours=gradient_9)
vdisex_12 = VectorDisplayEx(Point=move_2.Geometry, Vector=multiplication_10, Colour=swatch_2, Width=2)
vdisex_13 = VectorDisplayEx(Point=move_3.Geometry, Vector=multiplication_11, Colour=swatch, Width=2)

# ---- group: Section Visualisation
list_6 = ValueList({"Total Def.": 0, "Directional Def.": 1}, selected="Total Def.")
number_slider_8 = Slider(1, range=-50..50)
panel_62 = Panel("Amplification Factor")
panel_63 = Panel("Section Plane Distance")
entwine_6 = Entwine(Branch00=gradient_8, Branch01=gradient_9, FlattenInputs=True)
pl_3pt = Plane3Pt(PointA=deplane.Origin, PointB=deplane.XAxis, PointC=deplane.ZAxis)
multiplication_16 = Multiplication(A=py3.UVecExp, B=Slider(5, range=0..100))
multiplication_17 = Multiplication(A=deplane.YAxis, B=number_slider_8)
branch_4 = TreeBranch(Tree=simplify(entwine_6), Path=list_6, MaintainPaths=True)
addition_4 = Addition(A=dam.DataSourceMeshVer, B=multiplication_16)
move_4 = Move(Geometry=pl_3pt, Motion=multiplication_17)  # -> Geometry, Transform
panel_64 = Panel("Reference")
panel_65 = Panel("Target")
panel_66 = Panel("Def.")
panel_67 = Panel("Def. Amp.")
sec = MeshPlane(Mesh=meshrepair, Plane=move_4.Geometry)
sec_2 = MeshPlane(Mesh=mesh_3, Plane=move_4.Geometry)
sec_3 = MeshPlane(Mesh=mesh_7, Plane=move_4.Geometry)
sec_4 = CloudPlane(Cloud=clo, Plane=move_4.Geometry, Tolerance="0.1", Project=False)
panel_68 = Panel("""0.25
-0.25
0.05
-0.25""")
linetype = ModelLinetype(Name="curtom", JoinStyle=0, Width=Slider(0.05, range=0..1))  # -> ModelLinetype, Name, Segments, CapStyle, JoinStyle, Width, WidthUnits
linetype_2 = ModelLinetype(Name="curtom", JoinStyle=0, Width=Slider(0.025, range=0..1))  # -> ModelLinetype, Name, Segments, CapStyle, JoinStyle, Width, WidthUnits
linetype_3 = ModelLinetype(Name="curtom", JoinStyle=0, Width=Slider(0.05, range=0..1))  # -> ModelLinetype, Name, Segments, CapStyle, JoinStyle, Width, WidthUnits
swatch_3 = ColourSwatch(SwatchColor=RGB(0, 0, 0))
swatch_4 = ColourSwatch(SwatchColor=RGB(130, 61, 0))
swatch_5 = ColourSwatch(SwatchColor=RGB(255, 119, 0))

# ----
view = ModelView(View=move_4.Geometry, Title="sections", Perspective=False, Location=pl_3pt, Target=number_slider_8)  # -> View, Title, Perspective, Location, Target, XExtents, YExtents, ZExtents

conmesh_5 = ConstructMesh(Vertices=addition_4, Faces=triangle, Colours=branch_4)
curve_preview = CustomCurvePreview(Curve=sec, Linetype=linetype.ModelLinetype, Colour=swatch_3)

# ---- group: Section Visualisation (continued)
sec_5 = MeshPlane(Mesh=conmesh_5, Plane=move_4.Geometry)
redpline = Reduce(Polyline=sec_5, Tolerance="0.15")  # -> Polyline, Reduction
reb_2 = RebuildCurve(Curve=sec_5, Degree=1, Count="25", Tangents=False)
reb_3 = RebuildCurve(Curve=redpline.Polyline, Degree=1, Count="20", Tangents=False)
smoothpline = SmoothPolyline(Polyline=sec_5, Strength=1, Times="50")

# ----
curve_preview_2 = CustomCurvePreview(Curve=sec_5, Linetype=linetype_2.ModelLinetype, Colour=swatch_4)
curve_preview_3 = CustomCurvePreview(Curve=reb_2, Linetype=linetype_3.ModelLinetype, Colour=swatch_5)

# ==== cluster Cluster
A = ClusterInput()
B = ClusterInput()
d1 = ClusterInput()
multiplication = Multiplication(A=A, B=B)
merge = Merge(Data1=flatten(d1), Data2=flatten(multiplication))
i = ClusterInput()
item = ListItem(List=merge, Index=i, Wrap=True)
i_2 = ClusterOutput(item)

# ==== cluster Cluster_2
relay = ClusterInput()
relay_2 = ClusterInput()
vec2pt = Vector2Pt(PointA=relay_2, PointB=relay, Unitize=False)  # -> Vector, Length
ln = Line(StartPoint=relay_2, EndPoint=relay)
eval = EvaluateLength(Curve=reparameterize(ln), Length="1", Normalized=True)  # -> Point, Tangent, Parameter
eval_2 = EvaluateLength(Curve=reparameterize(ln), Length="0.70", Normalized=True)  # -> Point, Tangent, Parameter
pl = PlaneNormal(Origin=eval_2.Point, ZAxis=vec2pt.Vector)
dist = Distance(PointA=eval_2.Point, PointB=eval.Point)
multiplication = Multiplication(A=dist, B=-1)
deplane = DeconstructPlane(Plane=pl)  # -> Origin, XAxis, YAxis, ZAxis
merge = Merge(Data1=graft(deplane.XAxis), Data2=graft(deplane.XAxis), Data3=graft(deplane.YAxis), Data4=graft(deplane.YAxis))  # -> simplify(Result)
merge_2 = Merge(Data1=graft(dist), Data2=graft(multiplication), Data3=graft(dist), Data4=graft(multiplication))  # -> simplify(Result)
multiplication_2 = Multiplication(A=merge, B=merge_2)
move = Move(Geometry=simplify(graft(eval_2.Point)), Motion=multiplication_2)  # -> Geometry, Transform
len = Length(Curve=ln)  # -> expr("x*1000", Length)
move_2 = Move(Geometry=relay_2, Motion="0, 0, 0.008")  # -> Geometry, Transform
xz = XZPlane(Origin=move_2.Geometry)
format = Format(Format="{0:0.0}", Culture=127, Data0=len)
ln_2 = Line(StartPoint=simplify(graft(eval.Point)), EndPoint=move.Geometry)
panel = Panel(format)
merge_3 = Merge(Data1=simplify(graft(ln)), Data2=ln_2)
planw = ClusterOutput(xz)
T = ClusterOutput(format)
R = ClusterOutput(merge_3)
